# Grasshopper definition 1.gh (Grasshopper 1.0.5)
# plug-ins: Barnacle

point = Point([Point(208.277596, -90, 0), Point(179.7195664, -88.75369393, 0), Point(213.2542168, -56.20548405, 0), Point(180.8274694, -54.68039353, 0)])
list_item = ListItem(List=point, Index=0, Wrap=True)  # -> Item, Item1, Item2, Item3
barnacle = Barnacle(PointA=list_item.Item, PointB=list_item.Item1, PointC=list_item.Item2, PointD=list_item.Item3)
barnacle_2 = Barnacle()
